vi "Tx Continuous Async (CDB Cluster).gvi"   [LabVIEW Communications System Design Software 2.0.1]
panel controls:
  "Gain": f64 = 10
  "Active Antenna": string = "TX1"
  "Enabled Channels": string = "0"
  "Device ID": "niUSRPClass"
  "Array": T1[]
  "Initial Phase [Rad]": f64
  "Amplitude": f64
  "Duration per signal [s]": f64
  "timeout": f64 = 10
panel indicators:
  "Coerced IQ Rate": f64
  "Coerced Carrier Frequency": f64
  "Coerced Gain": f64
  "error out": error
  "Time Frequency": waveform<c128>
  "IQ graph": waveform<c128>
types:
  T1 = cluster{"Duration [s]": f64, "Number of chirps": i32, "On/off": bool, "Chirp Direction (Up/Down)": bool, "Carrier Frequency": f64, "IQ Rate": f64}
uses:
  NI::Analysis::Generation::Ramp Pattern by Samples.gvi
diagram:
  w1 = $"Enabled Channels"
  w2 = $"Device ID"
  s1 = 0  # shift register
  while {
    call "niUSRP Open Tx Session.gvi"(Device names=w2, Reset=TRUE) -> (session handle out=w3, Error Out=w4)
    Property Node(instance in=w3, "Enabled Channels"=w1, error in=w4) -> (error out=w5, instance out=w6)
    for {
      w7 = each element of $Array
      Property Node(instance in=w7) -> ("Duration [s]"=w14, "Number of chirps"=w15, "On/off"=w16, "Chirp Direction (Up/Down)"=w17, "Carrier Frequency"=w18, "IQ Rate"=w19)
      append w14 to w8
      append w15 to w9
      append w16 to w10
      append w17 to w11
      append w18 to w12
      append w19 to w13
    }
    Array Index(array=w12) -> (out0[s1]=w20)
    Array Index(array=w13) -> (out0[s1]=w21)
    call "niUSRP Configure Signal.gvi"(session handle=w6, IQ rate=w21, carrier frequency=w20, gain=$Gain, error in (no error)=w5, channel list=w1, active antenna=$"Active Antenna") -> (session handle out=w22, coerced IQ rate=w23, coerced carrier frequency=w24, coerced gain=w25, Error Out=w26)
    Reciprocal(x=w23) -> w27
    Array Index(array=w9) -> (out0[s1]=w28)
    Array Index(array=w8) -> (out0[s1]=w29)
    Divide(x=w29, y=w28) -> w30
    Multiply(w30, w23) -> w31
    Round To Nearest(number=w31) -> w32
    To Quad Integer(number=w32) -> w33
    Quotient And Remainder(x=w33, y=2) -> (x-y*floor(x/y)=w34)
    Add(w33, w34) -> w35
    Array Index(array=w11) -> (out0[s1]=w36)
    Divide(x=w23, y=2) -> w37
    Negate(x=w37) -> w38
    Select(s=w36, t=w37, f=w38) -> w39
    Add(w39, w24) -> w40
    Select(s=w36, t=w38, f=w37) -> w41
    Add(w24, w41) -> w42
    call "Ramp Pattern by Samples.gvi"(samples=w35, end=w42, start=w40) -> (ramp pattern=w43)
    Real And Imaginary To Complex(x=w43, y=w43) -> w44
    s2 = c128[] []  # shift register
    for (N = w28) {
      Build Array[ConcatenateInputs=True](s2, w44) -> w45
      next s2 = w45
    }
    Build Waveform Node(Y=s2, dt=w27) -> (output waveform=w46)
    $"Time Frequency" <- w46
    New Data Value Reference(data value=w46, error in (no error)=w26) -> (data value reference=w47, error out=w48)
    in-place (after w47) {
      Read Poser(ro0=w47) -> (ri0=w49)
      Property Node(instance in=w49) -> ("Y"=w50)
      Complex To Real Imaginary(x + iy=w50) -> (x=w51)
      Multiply(w51, PiTimes2) -> w52
      s3 = $"Initial Phase [Rad]"  # shift register
      for {
        w53 = each element of w52
        # Cumulative phase
        # dt = 1/Hz = 1/IQrate
        Multiply(w53, w27) -> w55
        Add(w55, s3) -> w56
        append w56 to w54
        next s3 = w56
      }
      Sine And Cosine(x=w54) -> (cos(x)=w57, sin(x)=w58)
      Real And Imaginary To Complex(x=w57, y=w58) -> w59
      Multiply(w59, $Amplitude) -> w60
      Property Node(instance in=w49, "Y"=w60) -> (instance out=w61)
      $"IQ graph" <- w61
      Write Poser(wi0=w61)
    }
    Array Index(array=w10) -> (out0[s1]=w62)
    Select(s=w62, t=1, f=0) -> w63
    Multiply(w59, w63) -> w64
    Multiply(w64, 0) -> w65
    Build Array[ConcatenateInputs=True](w64, w65) -> w66
    Divide(x=$"Duration per signal [s]", y=2) -> w67
    Divide(x=w67, y=w29) -> w68
    s4 = w66  # shift register
    for (N = w68) {
      Build Array[ConcatenateInputs=True](s4, w66) -> w69
      next s4 = w69
    }
    call "niUSRP Write Tx Data (CDB).gvi"(session handle=w22, data=s4, timeout=$timeout, error in (no error)=w48, channel list=w1) -> (session handle out=w70, Error Out=w71)
    $"Coerced IQ Rate" <- w23
    $"Coerced Carrier Frequency" <- w24
    $"Coerced Gain" <- w25
    Add(s1, 1) -> w72
    Array Size(array=w13) -> (size(s)=w73)
    Is Equal(x=w73, y=w72) -> w74
    next s1 = w72
    stop if w74
  }
  call "niUSRP Close Session.gvi"(handle in=w70, error in=w71) -> (error out=w75)
  $"error out" <- w75
