vi "Spectral Monitoring (History).gvi"   [LabVIEW NXG 3.1.0]
panel controls:
  "IQ Sampling Rate [S/sec]": f64 = 20000000
  "Carrier Frequency [Hz]": f64 = 2400000000
  "Gain [dB]": f64 = 40
  "Active Antenna": string = "RX1"
  "Stop": bool
  "Device ID": "USRP niUSRPClass"
  "save_duration": i32 = 150
  "SaveFile": bool = TRUE
  "Acq Duration [sec]": f64 = 0.00025
panel indicators:
  "Coerced IQ Sampling Rate": f64
  "Coerced Carrier Frequency": f64
  "Coerced Gain": f64
  "Spectrum": T1
  "Acquired signal": f64[][]
  "Frame Size [samples]": i64
  "error out": error
types:
  T1 = cluster{"f0": f64, "df": f64, "magnitude": f64[]}
uses:
  NI::USRP::niUSRP Open Rx Session.gvi
  NI::USRP::niUSRP Configure Signal.gvi
  NI::USRP::niUSRP Configure Number of Samples.gvi
  NI::USRP::niUSRP Initiate.gvi
  NI::USRP::niUSRP Fetch Rx Data (CDB WDT).gvi
  NI::Analysis::Measurement::Power Spectrum for 1 Chan (CDB).gvi
  NI::USRP::niUSRP Abort.gvi
  NI::USRP::niUSRP Close Session.gvi
  NI::G Core::Error::Legacy::Simple Error Handler.gvi
diagram:
  call "niUSRP Open Rx Session.gvi"(device names=$"Device ID") -> (session handle out=w1, error out=w2)
  Property Node(instance in=w1, "niUSRP"="0", error in=w2) -> (error out=w3, instance out=w4)
  # Configure a finite acquisition.
  call "niUSRP Configure Signal.gvi"(active antenna=$"Active Antenna", session handle=w4, error in=w3, IQ rate=$"IQ Sampling Rate [S/sec]", carrier frequency=$"Carrier Frequency [Hz]", gain=$"Gain [dB]", channel list="0") -> (session handle out=w5, error out=w6, coerced IQ rate=w7, coerced carrier frequency=w8, coerced gain=w9)
  Multiply(w7, $"Acq Duration [sec]") -> w10
  To Quad Integer(number=w10) -> w11
  # Acquire initial frame to prime pipeline.
  call "niUSRP Configure Number of Samples.gvi"(session handle=w5, error in=w6, number of samples is finite=TRUE, number of samples=w11) -> (session handle out=w12, error out=w13)
  call "niUSRP Initiate.gvi"(session handle=w12, error in=w13) -> (session handle out=w14, error out=w15)
  call "niUSRP Fetch Rx Data (CDB WDT).gvi"(session handle=w14, error in=w15, number of samples=w11, channel list="0") -> (session handle out=w16, error out=w17, data=w18)
  s1 = w17  # shift register
  s2 = w18  # shift register
  while (iteration -> i1) {
    call "niUSRP Initiate.gvi"(session handle=w16, error in=s1) -> (session handle out=w19, error out=w20)
    call "niUSRP Fetch Rx Data (CDB WDT).gvi"(session handle=w19, error in=w20, number of samples=w11, channel list="0") -> (session handle out=w21, error out=w22, data=w23)
    Logical Or(w22, $Stop) -> w24
    w25 = TRUE  # plot dB?
    call "Power Spectrum for 1 Chan (CDB).gvi"(신호=s2, dB On=w25, 에러 입력=s1) -> (파워 스펙트럼=w26)
    $Spectrum <- w26
    Quotient And Remainder(x=i1, y=$save_duration) -> (floor(x/y)=w27, x-y*floor(x/y)=w28)
    Is Equal To 0(x=w28) -> w29
    Logical And($SaveFile, w29) -> w30
    Property Node(instance in=s2) -> ("Y"=w31)
    Complex To Real Imaginary(x + iy=w31) -> (x=w32, y=w33)
    Build Array(w32, w33) -> w34
    Array To Spreadsheet String(array=w34, delimiter=",", format string="%.6f") -> (spreadsheet string=w35)
    case (w30) {
      frame False, Default { }
      frame True {
        Number To Decimal String(number=w27) -> (decimal integer string=w36)
        Concatenate Strings("data_", w36, ".csv") -> w37
        Get Component Directory() -> (Path=w38)
        Strip Path(path=w38) -> (stripped path=w39)
        Build Path(base path=w39, name or relative path=w37) -> (appended path=w40)
        Write To Text File(file (use dialog)=w40, text=w35)
      }
    }
    $"Acquired signal" <- w34
    next s1 = w22
    next s2 = w23
    stop if w24
  }
  call "niUSRP Abort.gvi"(session handle=w21, error in=s1) -> (session handle out=w41, error out=w42)
  call "niUSRP Close Session.gvi"(session handle=w41, error in=w42) -> (error out=w43)
  call "Simple Error Handler.gvi"(에러 입력=w43)
  $"Coerced IQ Sampling Rate" <- w7
  $"error out" <- w43
  $"Coerced Carrier Frequency" <- w8
  $"Coerced Gain" <- w9
  $"Frame Size [samples]" <- w11
